# Grasshopper definition Brep-Topology-Edge-Filter.gh (Grasshopper 0.9.56)
# plug-ins: Sandbox

brep = Brep(<brep referenced from the Rhino model>)
valency = Slider(2, range=1..6)
debrep = DeconstructBrep(Brep=brep)  # -> Faces, Edges, Vertices

brep_topo = BrepTopology(Brep=brep)  # -> FaceEdgeStructure, EdgeFaceStructure
brep_topo_edge_filter = BrepTopologyEdgeFilter(EdgeList=debrep.Edges, EdgeFaceStructure=brep_topo.EdgeFaceStructure, ValencyFilter=valency)  # -> ListOfEdgeIDs, ListOfEdges

pcen = PolygonCenter(Polyline=debrep.Faces)  # -> CenterV, CenterE
eval = EvaluateLength(Curve=debrep.Edges, Length=0.5, Normalized=True)  # -> Point, Tangent, Parameter
pipe = Pipe(Curve=brep_topo_edge_filter.ListOfEdges, Radius=5, Caps=0)
points = PointList(Points=pcen.CenterV, Tags=True, Lines=False, Size=20)
points_2 = PointList(Points=eval.Point, Tags=True, Lines=False, Size=15)
ef = Panel(brep_topo_edge_filter.ListOfEdgeIDs)
