# Grasshopper definition Brep-Topology-Edges.gh (Grasshopper 0.9.56)
# plug-ins: Sandbox

edge = Slider(18, range=0..47)
brep = Brep(<brep referenced from the Rhino model>)
debrep = DeconstructBrep(Brep=brep)  # -> Faces, Edges, Vertices
brep_topo = BrepTopology(Brep=brep)  # -> FaceEdgeStructure, EdgeFaceStructure
pcen = PolygonCenter(Polyline=debrep.Faces)  # -> CenterV, CenterE
eval = EvaluateLength(Curve=debrep.Edges, Length=0.5, Normalized=True)  # -> Point, Tangent, Parameter
branch = TreeBranch(Tree=brep_topo.FaceEdgeStructure, Path=edge, MaintainPaths=True)
item = ListItem(List=debrep.Edges, Index=edge, Wrap=True)
item_2 = ListItem(List=debrep.Faces, Index=branch, Wrap=True)
ef = Panel(branch)
points = PointList(Points=pcen.CenterV, Tags=True, Lines=False, Size=20)
points_2 = PointList(Points=eval.Point, Tags=True, Lines=False, Size=15)
pipe = Pipe(Curve=item, Radius=5, Caps=0)
