# Grasshopper definition Brep-Topology-Point-Filter.gh (Grasshopper 0.9.56)
# plug-ins: Sandbox

brep = Brep(<brep referenced from the Rhino model>)
valency = Slider(3, range=1..6)
debrep = DeconstructBrep(Brep=brep)  # -> Faces, Edges, Vertices

brep_topo_vertex = BrepTopologyVertex(Brep=brep)  # -> FaceVertexStructure, VertexFaceStructure
brep_topo_vertex_filter = BrepTopologyVertexFilter(VertexList=debrep.Vertices, VertexFaceStructure=brep_topo_vertex.VertexFaceStructure, ValencyFilter=valency)  # -> ListOfVertexIDs, ListOfVertices

pcen = PolygonCenter(Polyline=debrep.Faces)  # -> CenterV, CenterE
eval = EvaluateLength(Curve=debrep.Edges, Length=0.5, Normalized=True)  # -> Point, Tangent, Parameter
sph = Sphere(Base=brep_topo_vertex_filter.ListOfVertices, Radius=15)
points = PointList(Points=pcen.CenterV, Tags=True, Lines=False, Size=20)
points_2 = PointList(Points=eval.Point, Tags=True, Lines=False, Size=15)
V = Panel(brep_topo_vertex_filter.ListOfVertexIDs)
