# Grasshopper definition Brep-Topology-Points.gh (Grasshopper 0.9.56)
# plug-ins: Sandbox

point = Slider(9, range=0..47)
brep = Brep()
debrep = DeconstructBrep(Brep=brep)  # -> Faces, Edges, Vertices
brep_topo_vertex = BrepTopologyVertex(Brep=brep)  # -> FaceVertexStructure, VertexFaceStructure
pcen = PolygonCenter(Polyline=debrep.Faces)  # -> CenterV, CenterE
eval = EvaluateLength(Curve=debrep.Edges, Length=0.5, Normalized=True)  # -> Point, Tangent, Parameter
branch = TreeBranch(Tree=brep_topo_vertex.VertexFaceStructure, Path=point, MaintainPaths=True)
item = ListItem(List=debrep.Vertices, Index=point, Wrap=True)
item_2 = ListItem(List=debrep.Faces, Index=branch, Wrap=True)
vf = Panel(branch)
points = PointList(Points=debrep.Vertices, Tags=True, Lines=False, Size=15)
points_2 = PointList(Points=pcen.CenterV, Tags=True, Lines=False, Size=20)
sph = Sphere(Base=item, Radius=15)
