# Grasshopper definition Line-Topology.gh (Grasshopper 0.9.56)
# plug-ins: Sandbox, Kangaroo Components

rec = Rectangle({Plane=PlaneXY(0, 0, 0), Size=Domain2(u=0..640, v=0..360)})
crv = Curve(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)
pop2d = Populate2D(Region=rec, Count=25, Seed=1)
voronoi = Voronoi(Points=pop2d, BruteForceOverride=False)
trim = TrimWithRegion(Curve=voronoi, Region=crv)  # -> Inside, Outside
explode = Explode(Curve=trim.Inside, Recursive=True)  # -> flatten(Segments), Vertices
dupln = RemoveDuplicateLines(Lines=explode.Segments, Tolerance=0.01)
line = Line(dupln)
line_topo = LineTopology(ListOfLines=line, Tolerance=0.001)  # -> ListOfPoints, LinePointStructure, PointLineStructure
eval = EvaluateLength(Curve=line, Length=0.5, Normalized=True)  # -> Point, Tangent, Parameter
pl = Panel(line_topo.PointLineStructure)
points = PointList(Points=eval.Point, Tags=True, Lines=False, Size=7)
point = Slider(0, range=0..47)
points_2 = PointList(Points=line_topo.ListOfPoints, Tags=True, Lines=False, Size=10)
branch = TreeBranch(Tree=line_topo.PointLineStructure, Path=point, MaintainPaths=True)
item = ListItem(List=line, Index=branch, Wrap=True)
branch_2 = TreeBranch(Tree=line_topo.LinePointStructure, Path=branch, MaintainPaths=True)
equals = Equality(FirstNumber=branch_2, SecondNumber=point)  # -> Equality, Inequality
pipe = Pipe(Curve=item, Radius=5, Caps=0)
cull = CullPattern(List=branch_2, CullPattern=equals.Inequality)
item_2 = ListItem(List=line_topo.ListOfPoints, Index=cull, Wrap=True)
panel = Panel(cull)
