# Grasshopper definition Mesh-Topology-Edge.gh (Grasshopper 0.9.56)
# plug-ins: MeshEdit Components, Sandbox, Weaverbird

mesh = Mesh(<mesh referenced from the Rhino model>)
face = Slider(27, range=0..47)
mesh_topo_edge = MeshTopologyEdge(Mesh=mesh)  # -> FaceFaceStructure, EdgeFaceStructure
mesh_topo_vertex = MeshTopologyVertex(Mesh=mesh)  # -> VertexVertexStructure, VertexFaceStructure
demesh = DeconstructMesh(Mesh=mesh)  # -> Vertices, Faces, Colours, Normals
wbfacepolys = WeaverbirdsFacePolylines(Mesh=mesh)
explode = MeshExplode(Mesh=mesh, Interpolate=False)
wbedges = WeaverbirdsMeshEdges(MeshOrPolylines=mesh, FaceOrder=False)
pcen = PolygonCenter(Polyline=wbfacepolys)  # -> CenterV, CenterE
item = ListItem(List=wbedges, Index=face, Wrap=True)
branch = TreeBranch(Tree=mesh_topo_edge.FaceFaceStructure, Path=face, MaintainPaths=True)
branch_2 = TreeBranch(Tree=mesh_topo_edge.EdgeFaceStructure, Path=face, MaintainPaths=True)
item_2 = ListItem(List=explode, Index=face, Wrap=True)
item_3 = ListItem(List=explode, Index=branch, Wrap=True)
item_4 = ListItem(List=explode, Index=branch_2, Wrap=True)
pipe = Pipe(Curve=item, Radius=10, Caps=0)
points = PointList(Points=pcen.CenterV, Tags=True, Lines=False, Size=20)
points_2 = PointList(Points=demesh.Vertices, Tags=True, Lines=False, Size=15)
ff = Panel(branch_2)
