# Grasshopper definition Mesh-Topology-Vertex.gh (Grasshopper 0.9.56)
# plug-ins: MeshEdit Components, Sandbox, Weaverbird

mesh = Mesh(<mesh referenced from the Rhino model>)
vertex = Slider(11, range=0..47)
mesh_topo_vertex = MeshTopologyVertex(Mesh=mesh)  # -> VertexVertexStructure, VertexFaceStructure
demesh = DeconstructMesh(Mesh=mesh)  # -> Vertices, Faces, Colours, Normals
wbfacepolys = WeaverbirdsFacePolylines(Mesh=mesh)
explode = MeshExplode(Mesh=mesh, Interpolate=False)
pcen = PolygonCenter(Polyline=wbfacepolys)  # -> CenterV, CenterE
branch = TreeBranch(Tree=mesh_topo_vertex.VertexVertexStructure, Path=vertex, MaintainPaths=True)
branch_2 = TreeBranch(Tree=mesh_topo_vertex.VertexFaceStructure, Path=vertex, MaintainPaths=True)
item = ListItem(List=demesh.Vertices, Index=vertex, Wrap=True)
item_2 = ListItem(List=demesh.Vertices, Index=branch, Wrap=True)
item_3 = ListItem(List=explode, Index=branch_2, Wrap=True)
vv = Panel(branch)
points = PointList(Points=pcen.CenterV, Tags=True, Lines=False, Size=15)
points_2 = PointList(Points=demesh.Vertices, Tags=True, Lines=False, Size=20)
sph = Sphere(Base=item_2, Radius=10)
sph_2 = Sphere(Base=item, Radius=10)
