# Grasshopper definition Poly-Topology-Edge-Filter.gh (Grasshopper 0.9.56)
# plug-ins: Sandbox

tolerance = Slider(0.001, range=0.001..1)
valency = Slider(2, range=1..6)
crv = Curve([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])
pcen = PolygonCenter(Polyline=crv)  # -> CenterV, CenterE

poly_edge_topo = PolygonEdgeTopology(ListOfPolylines=crv, Tolerance=tolerance)  # -> ListOfEdges, FaceEdgeCollection, EdgeFaceCollection
edge_list = EdgeToplogyFilter(EdgeList=poly_edge_topo.ListOfEdges, EdgeLoopStructure=poly_edge_topo.EdgeFaceCollection, ValencyFilter=valency)  # -> ListOfEdgeIDs, ListOfEdges

eval = EvaluateLength(Curve=poly_edge_topo.ListOfEdges, Length=0.5, Normalized=True)  # -> Point, Tangent, Parameter
points = PointList(Points=pcen.CenterV, Tags=True, Lines=False, Size=20)
pipe = Pipe(Curve=edge_list.ListOfEdges, Radius=10, Caps=0)
points_2 = PointList(Points=eval.Point, Tags=True, Lines=False, Size=15)
ids = Panel(edge_list.ListOfEdgeIDs)
