# Grasshopper definition Poly-Topology-Edges.gh (Grasshopper 0.9.56)
# plug-ins: Sandbox, LunchBox

crv = Curve([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])
edge = Slider(7, range=0..47)
poly_edge_topo = PolygonEdgeTopology(PolygonNetwork=crv, Tolerance=Slider(0.001, range=0..1))  # -> OrderedListOfEdges, EdgeIndecesOrderedByFaceIndex, FaceIndecesOrderedByEdgeIndex
pcen = PolygonCenter(Polyline=crv)  # -> CenterV, CenterE
eval = EvaluateLength(Curve=poly_edge_topo.OrderedListOfEdges, Length=0.5, Normalized=True)  # -> Point, Tangent, Parameter
branch = TreeBranch(Tree=poly_edge_topo.FaceIndecesOrderedByEdgeIndex, Path=edge, MaintainPaths=True)
points = PointList(Points=pcen.CenterV, Tags=True, Lines=False, Size=20)
item = ListItem(List=poly_edge_topo.OrderedListOfEdges, Index=edge, Wrap=True)
item_2 = ListItem(List=crv, Index=branch, Wrap=True)
ef = Panel(branch)
points_2 = PointList(Points=eval.Point, Tags=True, Lines=False, Size=15)
patch = PatchSurface(EdgeCurves=graft(item_2), U=2, V=2, Tolerance=0.001)
pipe = Pipe(Curve=item, Radius=5, Caps=0)
