# Grasshopper definition Poly-Topology-Point-Filter.gh (Grasshopper 0.9.56)
# plug-ins: Sandbox

tolerance = Slider(0.001, range=0.001..1)
valency = Slider(1, range=1..6)
crv = Curve([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])
pcen = PolygonCenter(Polyline=crv)  # -> CenterV, CenterE

topology = PolygonTopology(ListOfPolylines=crv, Tolerance=tolerance)  # -> ListOfPoints, LoopPointStructure, PointLoopCollection
fpolyv = FilterPolygonVertices(PointList=topology.ListOfPoints, PointLoopStructure=topology.PointLoopCollection, ValencyFilter=valency)  # -> ListOfPointIDs, ListOfPoints

points = PointList(Points=pcen.CenterV, Tags=True, Lines=False, Size=20)
points_2 = PointList(Points=topology.ListOfPoints, Tags=True, Lines=False, Size=15)
item = ListItem(List=topology.ListOfPoints, Index=fpolyv.ListOfPointIDs, Wrap=True)
lp = Panel(fpolyv.ListOfPointIDs)
sph = Sphere(Base=item, Radius=20)
