# Grasshopper definition Poly-Topology-Point.gh (Grasshopper 0.9.56)
# plug-ins: Sandbox, LunchBox

tolerance = Slider(0.001, range=0.001..1)
point = Slider(6, range=0..47)
crv = Curve([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])
pcen = PolygonCenter(Polyline=crv)  # -> CenterV, CenterE
topology = PolygonTopology(ListOfPolylines=crv, Tolerance=tolerance)  # -> ListOfPoints, LoopPointStructure, PointLoopStructure
branch = TreeBranch(Tree=topology.PointLoopStructure, Path=point, MaintainPaths=True)
points = PointList(Points=pcen.CenterV, Tags=True, Lines=False, Size=20)
points_2 = PointList(Points=topology.ListOfPoints, Tags=True, Lines=False, Size=15)
item = ListItem(List=crv, Index=branch, Wrap=True)
item_2 = ListItem(List=topology.ListOfPoints, Index=point, Wrap=True)
pl = Panel(branch)
sph = Sphere(Base=item_2, Radius=20)
patch = PatchSurface(EdgeCurves=graft(item), U=2, V=2, Tolerance=0.001)
