# Grasshopper definition Poly-Topology.gh (Grasshopper 0.9.56)
# plug-ins: Sandbox

tolerance = Slider(0.001, range=0.001..1)
crv = Curve([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])
topology = PolygonTopology(PolygonNetwork=crv, Tolerance=tolerance)  # -> CollectionOfPointIDsAndValues, CollectionOfFacesAndAssociatedPointIDs, CollectionOfPointIDsAndAssociatedFaces
npolyv = NakedPolygonVertices(
    PointCollection=topology.CollectionOfPointIDsAndValues,
    PointFaceCollection=topology.CollectionOfPointIDsAndAssociatedFaces,
    FaceCount=Slider(1, range=0..10))  # -> ID, Naked
