# Grasshopper definition TopologyBrepEdge.gh (Grasshopper 1.0.8)
# plug-ins: Sandbox Topology

brep = Brep(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)

# ---- group: Multiple breps in the same branch are treated as one network
# "List faces that share a given edge."
# © 2025 by Tobias Schwinn
brep_2 = Brep(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)
brep_3 = Brep(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)

# ----
merge = Merge(Data1=[brep_3, brep_2], Data2=brep)
brep_4 = Brep(merge)
edge = Slider(29, range=0..29)
debrep = DeconstructBrep(Brep=brep_4)  # -> simplify(Faces), Edges, Vertices
brep_topo_edge = BrepTopologyEdge(Breps=brep_4)  # -> ListOfEdgeCurves, FaceEdgeStructure, EdgeFaceStructure
pshift = ShiftPaths(Data=debrep.Faces, Offset=-1)
format = Format(Format="{{*;{0}}}", Culture=127, Data0=edge)
split = SplitTree(Data=brep_topo_edge.EdgeFaceStructure, Masks=flatten(format))  # -> Positive, Negative
pcen = PolygonCenter(Polyline=pshift)  # -> CenterV, CenterE, CenterA
eval = EvaluateLength(Curve=brep_topo_edge.ListOfEdgeCurves, Length=0.5, Normalized=True)  # -> Point, Tangent, Parameter
ef = Panel(split.Positive)

# ---- group: Faces that do NOT share a given edge
cull_i = CullIndex(List=pshift, Indices=split.Positive, Wrap=True)

# ---- group: Faces adjacent to given edge
item = ListItem(List=pshift, Index=split.Positive, Wrap=True)

# ----
item_2 = ListItem(List=brep_topo_edge.ListOfEdgeCurves, Index=edge, Wrap=True)
points = PointList(Points=pcen.CenterV, Tags=True, Lines=False, Size=20)
points_2 = PointList(Points=eval.Point, Tags=True, Lines=False, Size=15)
pipe = Pipe(Curve=item_2, Radius=10, Caps=0)
preview = CustomPreview(Geometry=item, Material=ColourSwatch(SwatchColor=RGBA(147, 242, 92, 172)))
