# Grasshopper definition TopologyBrepEdgeFilter.gh (Grasshopper 1.0.8)
# plug-ins: Sandbox Topology

brep = Brep(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)

# ---- group: Multiple breps in the same branch are treated as one network
# "Select every edge that has N face neighbors."
# © 2025 by Tobias Schwinn
brep_2 = Brep(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)
brep_3 = Brep(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)

# ----
merge = Merge(Data1=[brep_3, brep_2], Data2=brep)
brep_4 = Brep(merge)
valency = Slider(1, range=1..3)
brep_topo_edge = BrepTopologyEdge(Breps=brep_4)  # -> ListOfEdgeCurves, FaceEdgeStructure, EdgeFaceStructure
debrep = DeconstructBrep(Brep=brep_4)  # -> Faces, Edges, Vertices
pshift = ShiftPaths(Data=debrep.Faces, Offset=-1)
pshift_2 = ShiftPaths(Data=debrep.Edges, Offset=-1)
brep_topo_edge_filter = BrepTopologyEdgeFilter(EdgeList=brep_topo_edge.ListOfEdgeCurves, EdgeFaceStructure=brep_topo_edge.EdgeFaceStructure, ValencyFilter=valency)  # -> ListOfEdgeIDs, ListOfEdges
pipe = Pipe(Curve=brep_topo_edge_filter.ListOfEdges, Radius=5, Caps=0)
pcen = PolygonCenter(Polyline=pshift)  # -> CenterV, CenterE, CenterA
item = ListItem(List=brep_topo_edge.ListOfEdgeCurves, Index=brep_topo_edge_filter.ListOfEdgeIDs, Wrap=True)
eval = EvaluateLength(Curve=pshift_2, Length=0.5, Normalized=True)  # -> Point, Tangent, Parameter
points = PointList(Points=pcen.CenterV, Tags=True, Lines=False, Size=20)
points_2 = PointList(Points=eval.Point, Tags=True, Lines=False, Size=15)
ids = Panel(brep_topo_edge_filter.ListOfEdgeIDs)
