# Grasshopper definition TopologyBrepVertex.gh (Grasshopper 1.0.8)
# plug-ins: Sandbox Topology

brep = Brep(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)

# ---- group: Multiple breps in the same branch are treated as one network
# "List faces that share a given vertex."
# © 2025 by Tobias Schwinn
brep_2 = Brep(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)
brep_3 = Brep(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)

# ----
merge = Merge(Data1=[brep_3, brep_2], Data2=brep)
brep_4 = Brep(merge)
vertex = Slider(0, range=0..23)
brep_topo_vertex = BrepTopologyVertex(Brep=brep_4)  # -> ListOfVertices, FaceVertexStructure, VertexFaceStructure
debrep = DeconstructBrep(Brep=brep_4)  # -> Faces, Edges, Vertices
pshift = ShiftPaths(Data=debrep.Faces, Offset=-1)
format = Format(Format="{{*;{0}}}", Culture=127, Data0=vertex)
split = SplitTree(Data=brep_topo_vertex.VertexFaceStructure, Masks=flatten(format))  # -> Positive, Negative
pcen = PolygonCenter(Polyline=pshift)  # -> CenterV, CenterE, CenterA
ef = Panel(split.Positive)
points = PointList(Points=brep_topo_vertex.ListOfVertices, Tags=True, Lines=False, Size=15)
points_2 = PointList(Points=pcen.CenterV, Tags=True, Lines=False, Size=20)
item = ListItem(List=brep_topo_vertex.ListOfVertices, Index=vertex, Wrap=True)

# ---- group: Faces that do NOT share a given vertex
cull_i = CullIndex(List=pshift, Indices=split.Positive, Wrap=True)

# ---- group: Faces adjacent to given vertex
item_2 = ListItem(List=pshift, Index=split.Positive, Wrap=True)

# ----
sph = Sphere(Base=item, Radius=15)
preview = CustomPreview(Geometry=item_2, Material=ColourSwatch(SwatchColor=RGBA(147, 242, 92, 172)))
