# Grasshopper definition TopologyBrepVertexFilter.gh (Grasshopper 1.0.8)
# plug-ins: Sandbox Topology

brep = Brep(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)

# ---- group: Multiple breps in the same branch are treated as one network
# "Select every vertex that has N face neighbors."
# © 2025 by Tobias Schwinn
brep_2 = Brep(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)
brep_3 = Brep(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)

# ----
merge = Merge(Data1=[brep_3, brep_2], Data2=brep)
brep_4 = Brep(merge)
valency = Slider(2, range=1..6)

brep_topo_vertex = BrepTopologyVertex(Brep=brep_4)  # -> ListOfVertices, FaceVertexStructure, VertexFaceStructure
brep_topo_vertex_filter = BrepTopologyVertexFilter(
    VertexList=brep_topo_vertex.ListOfVertices,
    VertexFaceStructure=brep_topo_vertex.VertexFaceStructure,
    ValencyFilter=valency)  # -> ListOfVertexIDs, ListOfVertices

debrep = DeconstructBrep(Brep=brep_4)  # -> Faces, Edges, Vertices
pshift = ShiftPaths(Data=debrep.Faces, Offset=-1)
pcen = PolygonCenter(Polyline=pshift)  # -> CenterV, CenterE, CenterA
sph = Sphere(Base=brep_topo_vertex_filter.ListOfVertices, Radius=15)
points = PointList(Points=pcen.CenterV, Tags=True, Lines=False, Size=20)
points_2 = PointList(Points=brep_topo_vertex.ListOfVertices, Tags=True, Lines=False, Size=15)
I = Panel(brep_topo_vertex_filter.ListOfVertexIDs)
