# Grasshopper definition TopologyLine.gh (Grasshopper 1.0.7)
# plug-ins: Sandbox Topology

crv = Curve([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])
# "List lines that share a given endpoint."
# "List points that are connected to a given point."
# © 2025 by Tobias Schwinn
crv_2 = Curve([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])
flatten = FlattenTree(Tree=crv_2, Path="{0}")
flatten_2 = FlattenTree(Tree=crv, Path="{1}")
merge = Merge(Data1=flatten, Data2=flatten_2)
line = Line(merge)
edge = Slider(0, range=0..47)
eval = EvaluateLength(Curve=line, Length=0.5, Normalized=True)  # -> Point, Tangent, Parameter
linetopoidx = LineTopologyIndex(ListOfLines=line, Tolerance=0.001)  # -> ListOfPoints, LinePointStructure, PointPointStructure, PointLineStructure
format = Format(Format="{{*;{0}}}", Culture=127, Data0=edge)
points = PointList(Points=eval.Point, Tags=True, Lines=False, Size=7)
points_2 = PointList(Points=linetopoidx.ListOfPoints, Tags=True, Lines=False, Size=10)
split = SplitTree(Data=linetopoidx.PointLineStructure, Masks=flatten(format))  # -> Positive, Negative
split_2 = SplitTree(Data=linetopoidx.PointPointStructure, Masks=flatten(format))  # -> Positive, Negative
pl = Panel(split.Positive)
item = ListItem(List=linetopoidx.ListOfPoints, Index=edge, Wrap=True)

# ---- group: Line that do NOT share a given point
cull_i = CullIndex(List=line, Indices=split.Positive, Wrap=True)

# ---- group: Endpoints connected to given point
item_2 = ListItem(List=linetopoidx.ListOfPoints, Index=split_2.Positive, Wrap=True)

# ---- group: Lines connected to given point
item_3 = ListItem(List=line, Index=split.Positive, Wrap=True)

# ----
pp = Panel(split_2.Positive)
pipe = Pipe(Curve=cull_i, Radius=2, Caps=0)
sph = Sphere(Base=item_2, Radius=10)
pipe_2 = Pipe(Curve=item_3, Radius=2, Caps=0)
preview = CustomPreview(Geometry=pipe_2, Material=ColourSwatch(SwatchColor=RGBA(147, 242, 92, 172)))
