# Grasshopper definition TopologyMeshEdge.gh (Grasshopper 1.0.8)
# plug-ins: MeshEdit Components, Sandbox Topology, Weaverbird

# ---- group: Multiple meshes in the same branch are treated as one network
# "List faces that share a given edge."
# "List faces that are adjacent to a given face."
# © 2025 by Tobias Schwinn
mesh = Mesh(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)
mesh_2 = Mesh(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)

# ----
mesh_3 = Mesh(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)
merge = Merge(Data1=[mesh, mesh_2], Data2=mesh_3)
mesh_4 = Mesh(merge)
edge = Slider(127, range=0..180)
face = Slider(84, range=0..181)
mesh_topo_edge = MeshTopologyEdge(Mesh=mesh_4)  # -> ListOfEdges, FaceFaceStructure, EdgeFaceStructure
wbfacepolys = WeaverbirdsFacePolylines(Mesh=mesh_4)
explode = MeshExplode(Mesh=mesh_4, Interpolate=False)
format = Format(Format="{{*;{0}}}", Culture=127, Data0=face)
format_2 = Format(Format="{{*;{0}}}", Culture=127, Data0=edge)
pshift = ShiftPaths(Data=explode, Offset=-1)
pshift_2 = ShiftPaths(Data=wbfacepolys, Offset=-1)
split = SplitTree(Data=mesh_topo_edge.FaceFaceStructure, Masks=flatten(format))  # -> Positive, Negative
split_2 = SplitTree(Data=mesh_topo_edge.EdgeFaceStructure, Masks=flatten(format_2))  # -> Positive, Negative
pcen = PolygonCenter(Polyline=pshift_2)  # -> CenterV, CenterE, CenterA
eval = EvaluateLength(Curve=mesh_topo_edge.ListOfEdges, Length=0.5, Normalized=True)  # -> Point, Tangent, Parameter
ef = Panel(split_2.Positive)

# ---- group: Adjacent faces to given face
item = ListItem(List=pshift, Index=split.Positive, Wrap=True)

# ----
item_2 = ListItem(List=mesh_topo_edge.ListOfEdges, Index=edge, Wrap=True)

# ---- group: Adjacent faces to given edge
item_3 = ListItem(List=pshift, Index=split_2.Positive, Wrap=True)

# ----
item_4 = ListItem(List=pshift, Index=face, Wrap=True)
points = PointList(Points=eval.Point, Tags=True, Lines=False, Size=12)
points_2 = PointList(Points=pcen.CenterV, Tags=True, Lines=False, Size=20)
ff = Panel(split.Positive)
pipe = Pipe(Curve=item_2, Radius=5, Caps=0)
