# Grasshopper definition TopologyMeshEdgeFilter.gh (Grasshopper 1.0.8)
# plug-ins: Sandbox Topology, Weaverbird

# ---- group: Multiple meshes in the same branch are treated as one network
# "Select every edge that has N face neighbors."
# © 2025 by Tobias Schwinn
mesh = Mesh(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)
mesh_2 = Mesh(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)

# ----
mesh_3 = Mesh(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)
merge = Merge(Data1=[mesh, mesh_2], Data2=mesh_3)
# N = 1 => "naked" edges
# N = 2 => "clothed" edges
valency = Slider(2, range=1..3)
mesh_4 = Mesh(merge)
wbfacepolys = WeaverbirdsFacePolylines(Mesh=mesh_4)

mesh_topo_edge = MeshTopologyEdge(Mesh=mesh_4)  # -> ListOfEdges, FaceFaceStructure, EdgeFaceStructure
mesh_topo_edge_filter = MeshTopologyEdgeFilter(EdgeList=mesh_topo_edge.ListOfEdges, EdgeFaceStructure=mesh_topo_edge.EdgeFaceStructure, ValencyFilter=valency)  # -> ListOfEdgeIDs, ListOfEdges

pshift = ShiftPaths(Data=wbfacepolys, Offset=-1)
item = ListItem(List=mesh_topo_edge.ListOfEdges, Index=mesh_topo_edge_filter.ListOfEdgeIDs, Wrap=True)
pipe = Pipe(Curve=mesh_topo_edge_filter.ListOfEdges, Radius=5, Caps=0)
pcen = PolygonCenter(Polyline=pshift)  # -> CenterV, CenterE, CenterA
eval = EvaluateLength(Curve=mesh_topo_edge.ListOfEdges, Length=0.5, Normalized=True)  # -> Point, Tangent, Parameter
I = Panel(mesh_topo_edge_filter.ListOfEdgeIDs)
points = PointList(Points=pcen.CenterV, Tags=True, Lines=False, Size=20)
points_2 = PointList(Points=eval.Point, Tags=True, Lines=False, Size=15)
