# Grasshopper definition TopologyMeshVertex.gh (Grasshopper 1.0.8)
# plug-ins: MeshEdit Components, Sandbox Topology, Weaverbird

# ---- group: Multiple meshes in the same branch are treated as one network
# "List vertices that are connected to a given vertex."
# "List faces that share a given vertex."
# © 2025 by Tobias Schwinn
mesh = Mesh(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)
mesh_2 = Mesh(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)

# ----
mesh_3 = Mesh(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)
merge = Merge(Data1=[mesh, mesh_2], Data2=mesh_3)
mesh_4 = Mesh(merge)
vertex = Slider(38, range=0..99)
mesh_topo_vertex = MeshTopologyVertex(Mesh=mesh_4)  # -> ListOfMeshVertices, VertexVertexStructure, VertexFaceStructure
wbfacepolys = WeaverbirdsFacePolylines(Mesh=mesh_4)
explode = MeshExplode(Mesh=mesh_4, Interpolate=False)
format = Format(Format="{{*;{0}}}", Culture=127, Data0=vertex)
pshift = ShiftPaths(Data=wbfacepolys, Offset=-1)
pshift_2 = ShiftPaths(Data=explode, Offset=-1)
split = SplitTree(Data=mesh_topo_vertex.VertexVertexStructure, Masks=flatten(format))  # -> Positive, Negative
split_2 = SplitTree(Data=mesh_topo_vertex.VertexFaceStructure, Masks=flatten(format))  # -> Positive, Negative
pcen = PolygonCenter(Polyline=pshift)  # -> CenterV, CenterE, CenterA

# ---- group: Faces that do NOT share a given vertex
cull_i = CullIndex(List=pshift_2, Indices=split_2.Positive, Wrap=True)

# ----
vf = Panel(split_2.Positive)
item = ListItem(List=mesh_topo_vertex.ListOfMeshVertices, Index=vertex, Wrap=True)

# ---- group: Vertices connected to given vertex
item_2 = ListItem(List=mesh_topo_vertex.ListOfMeshVertices, Index=split.Positive, Wrap=True)

# ---- group: Faces adjacent to given vertex
item_3 = ListItem(List=pshift_2, Index=split_2.Positive, Wrap=True)

# ----
points = PointList(Points=pcen.CenterV, Tags=True, Lines=False, Size=15)
points_2 = PointList(Points=mesh_topo_vertex.ListOfMeshVertices, Tags=True, Lines=False, Size=20)
vv = Panel(split.Positive)
sph = Sphere(Base=item_2, Radius=10)
sph_2 = Sphere(Base=item, Radius=10)
preview = CustomPreview(Geometry=item_3, Material=ColourSwatch(SwatchColor=RGBA(147, 242, 92, 172)))
