# Grasshopper definition TopologyPolyEdgeFilter.gh (Grasshopper 1.0.7)
# plug-ins: Sandbox Topology

crv = Curve([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])
# "Select every edge that has N face neighbors."
# © 2025 by Tobias Schwinn
crv_2 = Curve([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])
flatten = FlattenTree(Tree=crv_2, Path="{0}")
flatten_2 = FlattenTree(Tree=crv, Path="{1}")
merge = Merge(Data1=flatten, Data2=flatten_2)
tolerance = Slider(0.001, range=0.001..1)
# N = 1 => "naked" edges
# N = 2 => "clothed" edges
valency = Slider(1, range=1..3)
crv_3 = Curve(merge)
pcen = PolygonCenter(Polyline=crv_3)  # -> CenterV, CenterE, CenterA

poly_topo_edge = PolygonTopologyEdge(ListOfPolylines=crv_3, Tolerance=tolerance)  # -> ListOfEdges, LoopEdgeStructure, EdgeLoopStructure
edge_list = EdgeToplogyFilter(EdgeList=poly_topo_edge.ListOfEdges, EdgeLoopStructure=poly_topo_edge.EdgeLoopStructure, ValencyFilter=valency)  # -> ListOfEdgeIDs, ListOfEdges

eval = EvaluateLength(Curve=poly_topo_edge.ListOfEdges, Length=0.5, Normalized=True)  # -> Point, Tangent, Parameter
points = PointList(Points=pcen.CenterV, Tags=True, Lines=False, Size=20)
pipe = Pipe(Curve=edge_list.ListOfEdges, Radius=5, Caps=0)
points_2 = PointList(Points=eval.Point, Tags=True, Lines=False, Size=15)
ids = Panel(edge_list.ListOfEdgeIDs)
