# Grasshopper definition TopologyPolyPoint.gh (Grasshopper 1.0.7)
# plug-ins: LunchBox, Sandbox Topology

crv = Curve([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])
# "List faces that share a given vertex."
# © 2025 by Tobias Schwinn
crv_2 = Curve([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])
flatten = FlattenTree(Tree=crv_2, Path="{0}")
flatten_2 = FlattenTree(Tree=crv, Path="{1}")
merge = Merge(Data1=flatten, Data2=flatten_2)
tolerance = Slider(0.001, range=0.001..1)
crv_3 = Curve(merge)
vertex = Slider(0, range=0..47)
topology = PolygonTopology(ListOfPolylines=crv_3, Tolerance=tolerance)  # -> ListOfPoints, LoopPointStructure, PointLoopStructure
pcen = PolygonCenter(Polyline=crv_3)  # -> CenterV, CenterE, CenterA
format = Format(Format="{{*;{0}}}", Culture=127, Data0=vertex)
points = PointList(Points=pcen.CenterV, Tags=True, Lines=False, Size=20)
points_2 = PointList(Points=topology.ListOfPoints, Tags=True, Lines=False, Size=15)
split = SplitTree(Data=topology.PointLoopStructure, Masks=flatten(format))  # -> Positive, Negative
item = ListItem(List=topology.ListOfPoints, Index=vertex, Wrap=True)

# ---- group: Polylines that share a given vertex
item_2 = ListItem(List=crv_3, Index=split.Positive, Wrap=True)

# ---- group: Polylines that do NOT share a given vertex
cull_i = CullIndex(List=crv_3, Indices=split.Positive, Wrap=True)

# ----
pl = Panel(split.Positive)
patch = PatchSurface(EdgeCurves=graft(item_2), U=2, V=2, Tolerance=0.001)
sph = Sphere(Base=item, Radius=20)
preview = CustomPreview(Geometry=patch, Material=ColourSwatch(SwatchColor=RGBA(147, 242, 92, 172)))
