# Grasshopper definition TopologyPolyPointFilter.gh (Grasshopper 1.0.7)
# plug-ins: Sandbox Topology

crv = Curve([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])
# © 2025 by Tobias Schwinn
crv_2 = Curve([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])
flatten = FlattenTree(Tree=crv_2, Path="{0}")
flatten_2 = FlattenTree(Tree=crv, Path="{1}")
merge = Merge(Data1=flatten, Data2=flatten_2)
# "Select every vertex that is connected to N faces."
tolerance = Slider(0.001, range=0.001..1)
crv_3 = Curve(merge)
valency = Slider(2, range=1..6)
pcen = PolygonCenter(Polyline=crv_3)  # -> CenterV, CenterE, CenterA

topology = PolygonTopology(ListOfPolylines=crv_3, Tolerance=tolerance)  # -> ListOfPoints, LoopPointStructure, PointLoopCollection
fpolyv = FilterPolygonVertices(PointList=topology.ListOfPoints, PointLoopStructure=topology.PointLoopCollection, ValencyFilter=valency)  # -> ListOfPointIDs, ListOfPoints

points = PointList(Points=pcen.CenterV, Tags=True, Lines=False, Size=20)
points_2 = PointList(Points=topology.ListOfPoints, Tags=True, Lines=False, Size=15)
I = Panel(fpolyv.ListOfPointIDs)
sph = Sphere(Base=fpolyv.ListOfPoints, Radius=20)
