# Grasshopper definition TopologyPolygon.gh (Grasshopper 1.0.7)
# plug-ins: Sandbox Topology

crv = Curve([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])
crv_2 = Curve([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])
flatten = FlattenTree(Tree=crv_2, Path="{0}")
flatten_2 = FlattenTree(Tree=crv, Path="{1}")
merge = Merge(Data1=flatten, Data2=flatten_2)
crv_3 = Curve([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])
crv_4 = Curve([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])
flatten_3 = FlattenTree(Tree=crv_4, Path="{0}")
flatten_4 = FlattenTree(Tree=crv_3, Path="{1}")
merge_2 = Merge(Data1=flatten_3, Data2=flatten_4)
number_slider = Slider(2, range=0..6)
poly_topo_edge = PolygonTopologyEdge(ListOfPolylines=merge, Tolerance=0.001)  # -> ListOfEdges, LoopEdgeStructure, EdgeLoopStructure
poly_topo_point = PolygonTopologyPoint(ListOfPolylines=merge, Tolerance=0.001)  # -> ListOfPoints, LoopPointStructure, PointLoopStructure
linetopoidx = LineTopologyIndex(ListOfLines=merge_2, Tolerance=0.001)  # -> ListOfPoints, LinePointStructure, PointPointStructure, PointLineStructure
line_topo = LineTopology(ListOfLines=merge_2, Tolerance=0.001)  # -> ListOfPoints, LinePointStructure, PointPointStructure, PointLineStructure
item = ListItem(List=merge_2, Index=linetopoidx.PointLineStructure, Wrap=True)
poly_topo_edge_filter = PolygonTopologyEdgeFilter(EdgeList=poly_topo_edge.ListOfEdges, EdgeLoopStructure=poly_topo_edge.EdgeLoopStructure, ValencyFilter=number_slider)  # -> ListOfEdgeIDs, ListOfEdges
poly_topo_point_filter = PolygonTopologyPointFilter(
    PointList=poly_topo_point.ListOfPoints,
    PointLoopStructure=poly_topo_point.PointLoopStructure,
    ValencyFilter=number_slider)  # -> ListOfPointIDs, ListOfPoints
line_filter = LineTopologyFilter(ListOfPoints=linetopoidx.ListOfPoints, PointLineStructure=item, ValencyFilter=Slider(2, range=0..6))  # -> ListOfPoints, LineStructure
