# Grasshopper definition Validate_inputs.gh (Grasshopper 1.0.8)
# plug-ins: Sandbox Topology

crv = Curve(<curve referenced from the Rhino model>)
crv_2 = Curve()
mesh = Mesh()
mesh_2 = Mesh(Tree({1}: [], {2}: [null]))
line = Line()
line_2 = Line(Tree({1}: [], {2}: [Line((0, 0, 0), (0, 0, 0))]))
brep = Brep()
brep_2 = Brep(Tree({1}: [], {2}: [null]))
bang = ExplodeTree(Data=crv_2)  # -> Branch0, Branch1
topoly = CurveToPolyline(Curve=crv, ToleranceDistance=0, ToleranceAngle=0)  # -> Polyline, Segments
panel = Panel(brep_2)
panel_2 = Panel(line_2)
relay = Relay([topoly.Polyline, crv_2])
viewer = ParamViewer(brep)
panel_3 = Panel(crv)
mesh_topo_vertex = MeshTopologyVertex(Meshes=mesh)  # -> ListOfMeshVertices, VertexVertexStructure, VertexFaceStructure
mesh_topo_edge = MeshTopologyEdge(Mesh=mesh)  # -> ListOfEdges, FaceFaceStructure, EdgeFaceStructure
poly_topo_edge = PolygonTopologyEdge(ListOfPolylines=relay, Tolerance=0.001)  # -> ListOfEdges, LoopEdgeStructure, EdgeLoopStructure
poly_topo_point = PolygonTopologyPoint(ListOfPolylines=relay, Tolerance=0.001)  # -> ListOfPoints, LoopPointStructure, PointLoopStructure
brep_topo_edge = BrepTopologyEdge(Breps=brep)  # -> ListOfEdgeCurves, FaceEdgeStructure, EdgeFaceStructure
brep_topo_vertex = BrepTopologyVertex(Brep=brep)  # -> ListOfVertices, FaceVertexStructure, VertexFaceStructure
linetopoidx = LineTopologyIndex(ListOfLines=line, Tolerance=0.001)  # -> ListOfPoints, ListOfLines, LinePointStructure, PointPointStructure, PointLineStructure
brep_topo_vertex_filter = BrepTopologyVertexFilter(VertexList=brep_topo_vertex.ListOfVertices, VertexFaceStructure=brep_topo_vertex.VertexFaceStructure, ValencyFilter=1)  # -> ListOfVertexIDs, ListOfVertices
brep_topo_edge_filter = BrepTopologyEdgeFilter(EdgeList=brep_topo_edge.ListOfEdgeCurves, EdgeFaceStructure=brep_topo_edge.EdgeFaceStructure, ValencyFilter=1)  # -> ListOfEdgeIDs, ListOfEdges
poly_topo_edge_filter = PolygonTopologyEdgeFilter(EdgeList=poly_topo_edge.ListOfEdges, EdgeLoopStructure=poly_topo_edge.EdgeLoopStructure, ValencyFilter=1)  # -> ListOfEdgeIDs, ListOfEdges
line_point_filter = LineTopologyPointFilter(ListOfPoints=linetopoidx.ListOfPoints, PointPointStructure=linetopoidx.PointPointStructure, ValencyFilter=1)  # -> ListOfPoints, ListOfPointIDs
line_edge_filter = LineTopologyEdgeFilter(ListOfLines=linetopoidx.ListOfLines, PointLineStructure=linetopoidx.PointLineStructure, ValencyFilter=1)  # -> ListOfLines, ListOfLineIDs
mesh_topo_vertex_filter = MeshTopologyVertexFilter(
    VertexList=mesh_topo_vertex.ListOfMeshVertices,
    VertexFaceStructure=mesh_topo_vertex.VertexFaceStructure,
    ValencyFilter=1)  # -> ListOfVertexIDs, ListOfVertices
poly_topo_point_filter = PolygonTopologyPointFilter(PointList=poly_topo_point.ListOfPoints, PointLoopStructure=poly_topo_point.PointLoopStructure, ValencyFilter=1)  # -> ListOfPointIDs, ListOfPoints
mesh_topo_edge_filter = MeshTopologyEdgeFilter(EdgeList=mesh_topo_edge.ListOfEdges, EdgeFaceStructure=mesh_topo_edge.EdgeFaceStructure, ValencyFilter=1)  # -> ListOfEdgeIDs, ListOfEdges
viewer_2 = ParamViewer(poly_topo_edge.ListOfEdges)
